# Grasshopper definition palette_git_master.gh (Grasshopper 1.0.7)
# plug-ins: Triceratops, Githopper, Palette

# ---- group: Palette
swatch = ColourSwatch(SwatchColor=RGBA(0, 255, 255, 0))
swatch_2 = ColourSwatch(SwatchColor=RGB(64, 70, 67))
swatch_3 = ColourSwatch(SwatchColor=RGBA(0, 0, 0, 28))
swatch_4 = ColourSwatch(SwatchColor=RGB(68, 255, 156))
swatch_5 = ColourSwatch(SwatchColor=RGB(255, 187, 156))
swatch_6 = ColourSwatch(SwatchColor=RGB(241, 111, 90))
swatch_7 = ColourSwatch(SwatchColor=RGBA(255, 0, 72, 179))
swatch_8 = ColourSwatch(SwatchColor=RGB(255, 0, 72))
swatch_9 = ColourSwatch(SwatchColor=RGB(40, 50, 50))
swatch_10 = ColourSwatch(SwatchColor=RGB(255, 255, 255))
swatch_11 = ColourSwatch(SwatchColor=RGB(255, 55, 72))
number_slider = Slider(15, range=0..100)
swatch_12 = ColourSwatch(SwatchColor=RGBA(255, 255, 255, 160))
palette = Palette(
    ModeCustomStandard=Toggle(True),
    Component_Normal_Deselected_Fill_Color=swatch_2,
    Component_Normal_Deselected_Edge_Color=swatch_3,
    Component_Normal_Deselected_Text_Color=swatch_12,
    Component_Normal_Selected_Fill_Color=swatch_4,
    Component_Normal_Selected_Edge_Color=swatch_3,
    Component_Normal_Selected_Text_Color=ColourSwatch(SwatchColor=RGB(0, 0, 0)),
    Component_Hidden_Deselected_Fill_Color=swatch_3,
    Component_Hidden_Deselected_Edge_Color=swatch_3,
    Component_Hidden_Deselected_Text_Color=swatch_12,
    Component_Hidden_Selected_Fill_Color=ColourSwatch(SwatchColor=RGBA(68, 255, 156, 137)),
    Component_Hidden_Selected_Edge_Color=swatch_3,
    Component_Hidden_Selected_Text_Color=ColourSwatch(SwatchColor=RGBA(0, 0, 0, 203)),
    Component_Disabled_Deselected_Fill_Color=swatch,
    Component_Disabled_Deselected_Edge_Color=swatch,
    Component_Disabled_Deselected_Text_Color=swatch_2,
    Component_Disabled_Selected_Fill_Color=RGB(110, 150, 115),
    Component_Disabled_Selected_Edge_Color=RGB(40, 70, 40),
    Component_Disabled_Selected_Text_Color=RGB(75, 100, 65),
    Component_Warning_Deselected_Fill_Color=swatch_5,
    Component_Warning_Deselected_Edge_Color=swatch_5,
    Component_Warning_Deselected_Text_Color=RGB(0, 0, 0),
    Component_Warning_Selected_Fill_Color=swatch_6,
    Component_Warning_Selected_Edge_Color=swatch_6,
    Component_Warning_Selected_Text_Color=RGB(0, 0, 0),
    Component_Error_Deselected_Fill_Color=swatch_7,
    Component_Error_Deselected_Edge_Color=swatch_7,
    Component_Error_Deselected_Text_Color=swatch_9,
    Component_Error_Selected_Fill_Color=swatch_8,
    Component_Error_Selected_Edge_Color=swatch_8,
    Component_Error_Selected_Text_Color=swatch_9,
    Component_Label_Deselected_Fill_Color=swatch_9,
    Component_Label_Deselected_Edge_Color=swatch_9,
    Component_Label_Deselected_Text_Color=swatch_10,
    Component_Label_Selected_Fill_Color=swatch_9,
    Component_Label_Selected_Edge_Color=swatch_9,
    Component_Label_Selected_Text_Color=swatch_10,
    Galapagos_Deselected_Fill_Color=swatch_11,
    Galapagos_Deselected_Edge_Color=swatch_3,
    Galapagos_Selected_Fill_Color=swatch_4,
    Galapagos_Selected_Edge_Color=swatch_3,
    Wire_Normal_Color=swatch_12,
    Wire_Empty_Color=swatch_3,
    Wire_Selected_Start_Color=swatch_4,
    Wire_Selected_End_Color=ColourSwatch(SwatchColor=RGB(0, 255, 255)),
    Panel_Default_Color=swatch_10,
    Group_Default_Color=swatch_11,
    Canvas_Background_Color=swatch_9,
    Canvas_Gridline_Color=ColourSwatch(SwatchColor=RGB(50, 60, 60)),
    Canvas_Gridline_Width=number_slider,
    Canvas_Gridline_Height=number_slider,
    Canvas_Edge_Color=swatch_11,
    Canvas_Shadow_Color=swatch_11,
    Canvas_Shadow_Size=Slider(100, range=0..100),
    MonochromaticOnOff=False,
    Monochromatic_Color=RGB(212, 208, 200))

# ----
toggle = BooleanToggle(True)  # disabled
panel = Panel("http://localhost:8080/grasshopper/")  # disabled
httpin = HttpInput(Start=toggle, Prefix=panel)  # -> Keys, Values, ListenerObject; disabled
httpout = HttpOutput(HttpListener=httpin.ListenerObject)  # disabled

mesh = Mesh(<mesh referenced from the Rhino model>)
demesh = DeconstructMesh(Mesh=mesh)  # -> Vertices, Faces, Colours, Normals
scale = Scale(Geometry=mesh, Center=Point(0, 0, 0), Factor=Slider(1.1, range=0..10))  # -> Geometry, Transform
nickname = RelativePath()

# ---- group: Github Integration
button = Button()
toggle_2 = BooleanToggle(True)
username = Panel("l00sed")
email = Panel("danielwtompkins@gmail.com")
execute = ExecuteGitCommand(Command="git commit -m \"updated\" & exit", Execute=Button())
execute_2 = ExecuteGitCommand(Command="git push origin master & exit", Execute=Button())
execute_3 = ExecuteGitCommand(Command="git add -A & exit", Execute=Button())
select_branch = SelectBranch(Index=Slider(0, range=0..100))  # -> Branch, Branches
create_git = CreateGitRepository(User_name=username, User_email=email, Initialize=toggle_2)  # -> Report, Help
path = GitPath(Path=nickname, Create_path=toggle_2, Set=button)  # -> Report, Help
push = PushToRepository(Branch=select_branch.Branch, Repository="https://github.com/l00sed/grasshopper", Push=button)
panel_2 = Panel(create_git.Report)
panel_3 = Panel(push)
panel_4 = Panel(path.Report)

# ----
pdecon = Deconstruct(Point=demesh.Vertices)  # -> XComponent, YComponent, ZComponent
facen = FaceNormals(Mesh=scale.Geometry)  # -> Centers, Normals
sort = SortList(Keys=pdecon.XComponent, ValuesA=pdecon.XComponent)  # -> Keys, ValuesA
lng = ListLength(List=sort.Keys)
ln = Line(StartPoint=demesh.Vertices, EndPoint=facen.Centers)
item = ListItem(List=sort.Keys, Index=expr("x-1", lng), Wrap=True)
item_2 = ListItem(List=sort.Keys, Index=0, Wrap=True)
gradient = Gradient(LowerLimit=item_2, UpperLimit=item, Parameter=pdecon.XComponent, stops=[0.15: RGB(255, 130, 160), 0.85: RGB(220, 0, 40)])
linebasicmat = LineBasicMaterial(Color=ColourSwatch(SwatchColor=RGB(77, 201, 255)), LineWidth=Slider(0.5, range=0..1))  # -> JSON, LineMaterial
line = Line(Line=ln, LineMaterial=linebasicmat.LineMaterial)  # -> JSON, Geometry
colorface = MeshColorFaces(Mesh=mesh, Color=gradient)
weld = WeldMesh(Mesh=colorface, Angle=3.141592654)
standardmat = MeshStandardMaterial(
    Color=RGB(100, 149, 237),
    Opacity=1,
    Roughness=Slider(0, range=0..1),
    Metalness=Slider(0.1, range=0..1),
    Emissive=RGB(0, 0, 0),
    EmissiveIntensity=1,
    Wireframe=False,
    WireframeLineJoin="round",
    WireframeLineWidth=1)  # -> JSON, Material
meshvertex = MeshVertexColors(Mesh=weld, Name="meshStandardMaterial", Material=standardmat.Material)  # -> JSON, Geometry
merge = Merge(Data1=meshvertex.Geometry, Data2=line.Geometry)  # -> flatten(Result)
nickname_2 = RelativePath()
scene = CompileScene(Geometry=flatten(merge))  # -> JSON, Scene
concat = Concatenate(FragmentA=nickname_2, FragmentB="\threejs")
json = ExportJSON(Path=concat, FileName="example_scene", Data=scene.Scene, Write=Toggle(True))
path_2 = FilePath(json)
